# Grasshopper definition DesignMate.gh (Grasshopper 1.0.8)
# plug-ins: RhinoCodePluginGH, KohonenMapper, GH_DesignMate

maxheight = Slider(80, range=0..100)  # disabled

roofgardenbool = Slider(0, range=0..1)  # disabled
numfloors = Slider(5, range=1..10)  # disabled
facadetype = Slider(2, range=0..4)  # disabled
setback = Slider(5, range=0..8)  # disabled

numfloors_2 = Slider(1, range=1..10)  # disabled
facadetype_2 = Slider(0, range=0..4)  # disabled
setback_2 = Slider(1, range=0..8)  # disabled
roofgardenbool_2 = Slider(0, range=0..1)  # disabled

roofgardenbool_3 = Slider(1, range=0..1)  # disabled
numfloors_3 = Slider(3, range=1..10)  # disabled
setback_3 = Slider(3, range=0..8)  # disabled
facadetype_3 = Slider(1, range=0..4)  # disabled

roofgardenbool_4 = Slider(0, range=0..1)  # disabled
numfloors_4 = Slider(10, range=1..10)  # disabled
facadetype_4 = Slider(3, range=0..4)  # disabled
setback_4 = Slider(3, range=0..8)  # disabled

number_slider = Slider(4, range=0..10)  # disabled
number_slider_2 = Slider(4, range=0..10)  # disabled

# ---- group: Last floor geometry
brep = Brep(<brep referenced from the Rhino model>)  # disabled
brep_2 = Brep([<brep referenced from the Rhino model> x2])  # disabled
brep_3 = Brep([<brep referenced from the Rhino model> x60])  # disabled
brep_4 = Brep(<brep referenced from the Rhino model>)  # disabled
brep_5 = Brep([<brep referenced from the Rhino model> x51])  # disabled

# ----
slabs = Brep([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])
columns = Brep([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])
vertical_circulation = Brep([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])
ground_plane = Brep(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)
floormaker = CreateFloors(FacadePlaceholder=brep, Core=brep_2, Columns=brep_3, Slabs=brep_4, Beams=brep_5)  # disabled
mesh = Mesh(columns)
mesh_2 = Mesh(ground_plane)
mesh_3 = Mesh(vertical_circulation)
mesh_4 = Mesh(slabs)
c_script = CSharpScript(
    data=[numfloors_2, setback_2, facadetype_2, roofgardenbool_2, numfloors_3, setback_3, facadetype_3, roofgardenbool_3, numfloors, setback, facadetype, roofgardenbool, numfloors_4, setback_4, facadetype_4, roofgardenbool_4],
    numFeatures=number_slider_2)  # -> out, a; inputs data: list of Double, numFeatures: Int32; disabled
# ---------- c_script: C# ----------
// Grasshopper Script Instance
#region Usings
using System;
using System.Linq;
using System.Collections;
using System.Collections.Generic;
using System.Drawing;

using Rhino;
using Rhino.Geometry;

using Grasshopper;
using Grasshopper.Kernel;
using Grasshopper.Kernel.Data;
using Grasshopper.Kernel.Types;
#endregion

public class Script_Instance : GH_ScriptInstance
{
    #region Notes
    /* 
      Members:
        RhinoDoc RhinoDocument
        GH_Document GrasshopperDocument
        IGH_Component Component
        int Iteration

      Methods (Virtual & overridable):
        Print(string text)
        Print(string format, params object[] args)
        Reflect(object obj)
        Reflect(object obj, string method_name)
    */
    #endregion

    private void RunScript(List<double> data, int numFeatures, ref object a)
    {
        var tree = new DataTree<double>();
        GH_Path path;
        int legge = data.Count / numFeatures;
        int counter = 0;

        for (int i = 0; i < legge; i++)
        {
            path = new GH_Path(i);
            for (int j = 0; j < numFeatures; j++)
            {
                tree.Add(data[counter], path);
                counter++;
            }
        }
        a = tree;
    }
}
# ---------- end c_script ----------
X = UnitX(Factor=expr("-x", 1))
Y = UnitY(Factor=1)
xz = XZPlane(Origin=Point(0, 0, 0))
mcol = MeshColours(Mesh=mesh_4, Colours=ColourSwatch(SwatchColor=RGB(38, 149, 178)))
mcol_2 = MeshColours(Mesh=mesh, Colours=ColourSwatch(SwatchColor=RGB(93, 75, 69)))
mcol_3 = MeshColours(Mesh=mesh_3, Colours=ColourSwatch(SwatchColor=RGB(21, 167, 136)))
mcol_4 = MeshColours(Mesh=mesh_2, Colours=ColourSwatch(SwatchColor=RGB(244, 240, 248)))

# ---- group: 1. Set to false
toggle = BooleanToggle(False)  # disabled

# ----
# to update the inputs for generation:
# - disable all components after this group
# - toggle to true and then back to false
# - enable timer for a few seconds and then disable it
# - enable the components after this group
number_slider_3 = Slider(150, range=0..200)  # disabled
number_slider_4 = Slider(4, range=0..100)  # disabled
number_slider_5 = Slider(3, range=0..100)  # disabled
number_slider_6 = Slider(61, range=0..100)  # disabled
panel = Panel("0.999")  # disabled
panel_2 = Panel("0.998")  # disabled
number_slider_7 = Slider(0.6, range=0..1)  # disabled
panel_3 = Panel("0.95")  # disabled
panel_4 = Panel("0.9")  # disabled
kohonen_map = KohonenMap(
    Reset=toggle,
    XMap=number_slider_5,
    YMap=number_slider_4,
    Space=number_slider_3,
    Inputs=c_script.a,
    WinLearn=panel_3,
    Learn=panel_4,
    WinLearnDecay=panel,
    LearnDecay=panel_2,
    NeighDecay=0.99,
    NeighRad=number_slider_7,
    Seed=number_slider_6)  # -> Coverged, Counter, Locations, Synaptics, Neigh, InputLocations; disabled

pl = ConstructPlane(Origin=Point(0, 0, 0), XAxis=X, YAxis=Y)

# ---- group: check data structure
panel_5 = Panel(c_script.a)  # disabled

# ----
mjoin = MeshJoin(Meshes=mcol)
mjoin_2 = MeshJoin(Meshes=mcol_4)
mjoin_3 = MeshJoin(Meshes=mcol_2)
mjoin_4 = MeshJoin(Meshes=mcol_3)
orient = Orient(Geometry=mjoin, Source=pl, Target=xz)  # -> Geometry, Transform
orient_2 = Orient(Geometry=mjoin_3, Source=pl, Target=xz)  # -> Geometry, Transform
orient_3 = Orient(Geometry=mjoin_2, Source=pl, Target=xz)  # -> Geometry, Transform
orient_4 = Orient(Geometry=mjoin_4, Source=pl, Target=xz)  # -> Geometry, Transform

# ---- group: 2. Enable timer
timer = Timer(Interval=10, TimerInterval=10, Target=kohonen_map)  # disabled

# ----
bool = Boolean(roofgardenbool_2)  # disabled
c_script_2 = CSharpScript(mesh=orient.Geometry)  # -> base64Draco; inputs mesh: Mesh
# ---------- c_script_2: C# ----------
    var options = new Rhino.FileIO.DracoCompressionOptions();
    options.CompressionLevel = 5;
    options.IncludeTextureCoordinates = true;
    options.IncludeVertexColors = true;

    var compressed = Rhino.FileIO.DracoCompression.Compress(mesh, options);
    base64Draco = compressed.ToBase64String();
# ---------- end c_script_2 ----------
c_script_3 = CSharpScript(mesh=orient_2.Geometry)  # -> base64Draco; inputs mesh: Mesh; same code as c_script_2
c_script_4 = CSharpScript(mesh=orient_4.Geometry)  # -> base64Draco; inputs mesh: Mesh; same code as c_script_2
c_script_5 = CSharpScript(mesh=orient_3.Geometry)  # -> base64Draco; inputs mesh: Mesh; same code as c_script_2
panel_6 = Panel(bool)  # disabled

# ---- group: RH_OUT:Mesh_Slabs
txt = Text(c_script_2)

# ---- group: RH_OUT:Mesh_Columns
txt_2 = Text(c_script_3)

# ---- group: RH_OUT:Mesh_VerticalCirculation
txt_3 = Text(c_script_4)

# ---- group: RH_OUT:Mesh_Ground
txt_4 = Text(c_script_5)

# ----
pt = Point(kohonen_map.Locations)  # disabled
panel_7 = Panel(kohonen_map.Synaptics)  # disabled
item = ListItem(List=kohonen_map.Synaptics, Index=0, Wrap=True)  # -> Item, Item1, Item2, Item3; disabled
round = Round(Number=item.Item)  # -> Nearest, Floor, Ceiling; disabled
round_2 = Round(Number=item.Item1)  # -> Nearest, Floor, Ceiling; disabled
round_3 = Round(Number=item.Item2)  # -> Nearest, Floor, Ceiling; disabled
round_4 = Round(Number=item.Item3)  # -> Nearest, Floor, Ceiling; disabled
generategeomcomp = GenerateGeomComp(
    NumberOfFloors=round.Floor,
    SetbackM=round_2.Floor,
    FacadeType=round_3.Floor,
    AddRoofGarden=round_4.Floor,
    FloorList=floormaker,
    FtF=number_slider,
    MaxHeight=maxheight)  # -> FacadePlaceholder, Columns, Slabs, Core, Beams; disabled
vec = Vector(kohonen_map.Locations)  # disabled
geo = Geometry([<curve referenced from the Rhino model>, <brep referenced from the Rhino model> x7, <curve referenced from the Rhino model> x3, <brep referenced from the Rhino model> x4, <curve referenced from the Rhino model> x3, <brep referenced from the Rhino model> x2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])  # disabled
mesh_5 = MeshBrep(
    Brep=generategeomcomp.FacadePlaceholder,
    Settings={GridMaxCount=0, GridMinCount=16, JaggedSeams=False, MaxEdgeLength=0, MinEdgeLength=0.0001, MinTolerance=0, Refine=True, RefineAngle=0, RelativeTolerance=0.65, SimplePlanes=True, Tolerance=0})  # disabled
brep_6 = Brep([generategeomcomp.FacadePlaceholder, generategeomcomp.Columns, generategeomcomp.Slabs, generategeomcomp.Core, generategeomcomp.Beams])  # disabled
mjoin_5 = MeshJoin(Meshes=mesh_5)  # disabled

# ----
# move only for internal demonstration
move = Move(Geometry=brep_6, Motion=vec)  # -> Geometry, Transform; disabled
move_2 = Move(Geometry=geo, Motion=vec)  # -> Geometry, Transform; disabled
